# Grasshopper definition test.gh (Grasshopper 0.9.76)
# plug-ins: MeshEdit Components, Circulation

geo = Geometry(<curve referenced from the Rhino model>)
geo_2 = Geometry(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)
settings = NodeSettings(Geometry=geo_2)
settings_2 = NodeSettings()
pt = Point(Point(2, 14, 0))
pt_2 = Point(Point(12, 2, 0))
geo_3 = Geometry([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])
geo_4 = Geometry(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)
dwell = Point(Point(16, 23, 0))
dwell_2 = Point([Point(5, 42, 0), Point(30, 42, 0), Point(30, 25, 0), Point(5, 25, 0)])
node = Node(Position=pt, Name="end", Floor="floor")
node_2 = Node(Position=pt_2, Name="start", Floor="floor")
floor = Floor(Boundary=geo_4, Name="floor")
barrier = Barrier(Boundary=geo_3, Floor="floor")
node_3 = Node(Position=dwell_2, Name="dwell2", Floor="floor", Settings=settings_2)
node_4 = Node(Position=dwell, Name="dwell1", Floor="floor", Settings=settings)
settings_3 = AgentSettings(PathNodes=["dwell1", "dwell2"], NodePropensities=Slider(0.5, range=0..1), Count=Slider(50, range=0..1000))
agent = Agent(Name="agent", Origin="start", Destination="end", Settings=settings_3)
env = Environment(Entities=[floor, barrier, node_2, node, node_4, agent, node_3], Resolution=Slider(1, range=0..1), Run=Toggle(True))
number_slider = Slider(26, range=0..100)

apaths = AgentPaths(Environment=env, AgentName="agent")  # -> Mesh, Indexes, Log
explode = MeshExplode(Mesh=apaths.Mesh, Interpolate=False)
facen = FaceNormals(Mesh=explode)  # -> flatten(Centers), Normals
item = ListItem(List=facen.Centers, Index=apaths.Indexes, Wrap=True)
pline = PolyLine(Vertices=item, Closed=False)

bmap = BarrierMap(Environment=env, FloorName="floor")  # -> Mesh, Values
explode_2 = MeshExplode(Mesh=bmap.Mesh, Interpolate=False)
gradient = Gradient(LowerLimit=0, UpperLimit=1, Parameter=bmap.Values, stops=[0: RGB(0, 128, 0), 0.5: RGB(255, 255, 0), 1: RGB(255, 0, 0)])
preview = CustomPreview(Geometry=explode_2, Shader=gradient)

nmap = ZoneMap(Environment=env, NodeName="dwell1", Generation=number_slider)  # -> Mesh, Values
area = Area(Geometry=nmap.Mesh)  # -> Area, Centroid

dmap = DensityMap(Environment=env, FloorName="floor", Generation=number_slider, NonZero=Toggle(False))  # -> Mesh, Values
explode_3 = MeshExplode(Mesh=dmap.Mesh, Interpolate=False)
gradient_2 = Gradient(
    LowerLimit=Slider(1, range=0..1),
    UpperLimit=Slider(0, range=0..1),
    Parameter=dmap.Values,
    stops=[0: RGB(234, 38, 0), 0.25: RGB(234, 126, 0), 0.5: RGB(254, 244, 84), 0.75: RGB(173, 203, 249), 1: RGB(75, 107, 169)])
preview_2 = CustomPreview(Geometry=explode_3, Shader=gradient_2)

division = Division(A=nmap.Values, B=area.Area)
gradient_3 = Gradient(
    LowerLimit=Slider(1, range=0..1),
    UpperLimit=Slider(0, range=0..1),
    Parameter=division,
    stops=[0: RGB(234, 38, 0), 0.25: RGB(234, 126, 0), 0.5: RGB(254, 244, 84), 0.75: RGB(173, 203, 249), 1: RGB(75, 107, 169)])
panel = Panel(nmap.Values)
preview_3 = CustomPreview(Geometry=nmap.Mesh, Shader=gradient_3)
