# Grasshopper definition skeleton.ghx (Grasshopper 0.9.76)
# plug-ins: Python Interpreter

panel = Panel("-1")  # disabled
geo = Geometry(<curve referenced from the Rhino model>)  # disabled
geo_2 = Geometry(<curve referenced from the Rhino model>)
cp = ControlPoints(Curve=geo)  # -> Points, Weights, Knots; disabled
cp_2 = ControlPoints(Curve=geo_2)  # -> Points, Weights, Knots
cull_i = CullIndex(List=cp.Points, Indices=panel, Wrap=True)  # disabled
cull_i_2 = CullIndex(List=cp_2.Points, Indices="-1", Wrap=True)
python = PythonScript(pts=cull_i)  # -> out, a, b; inputs pts: list; disabled
# ---------- python: Python ----------
import rhinoscriptsyntax as rs

class Skeleton():
    
    def __init__(self, pts):
        
        self._slav = [pts] # double connected circular list of active vertices
        self._ie = {} # incident edges
        self._vab = {} # vertex angle bisectors
        self._bix = [] # bisector intersections / priority queue
        self._bo = {} # bisector origin pointers
    
    @property
    def lav(self):
        return self._slav[-1]
    
    @property
    def ie(self):
        return self._ie
    
    @property
    def vab(self):
        return self._vab
    
    @property
    def bix(self):
        return self._bix

    def set_ie_vab(self):
        l1, l2 = self.lav[1:] + [self.lav[0]], [self.lav[-1]] + self.lav[:-1]
        for i, pt in enumerate(self.lav):
            
            self._ie[pt] = [(pt, l1[i]),(pt, l2[i])]
            self._vab[pt] = rs.VectorAdd(
                rs.VectorUnitize(rs.VectorCreate(l1[i], pt)),
                rs.VectorUnitize(rs.VectorCreate(l2[i], pt)))
    
    def set_bix_priority_queue(self):
        for i, v in enumerate(self.lav):
            vli = rs.AddLine(v, v+self.vab[v])
            for ve in [self.ie[v][0][1], self.ie[v][1][1]]:
                vex = rs.LineLineIntersection(
                    rs.AddLine(ve, ve+self.vab[ve]),
                    vli)
                if vex:
                    self._bix.append((vex[0], rs.Distance(
                        rs.LineClosestPoint(
                            rs.AddLine(self.ie[v][0][0],
                                self.ie[v][0][1]),
                            vex[0]),
                        vex[0])))
                    self._bo[vex[0]] = (v, ve)
        self._bix.sort(key=lambda tup: tup[1])
        
    
    def compute_skeleton(self):
        pass
    
_temp = []
skel = Skeleton(rs.coerce3dpointlist(pts))
skel.set_ie_vab()
skel.set_bix_priority_queue()
a = [v[0] for v in skel.bix]
b = _temp
# ---------- end python ----------
python_2 = PythonScript(pts=cull_i_2)  # -> out, a, b; inputs pts: list
# ---------- python_2: Python ----------
import rhinoscriptsyntax as rs

class Skeleton():
    
    def __init__(self, pts):
        
        self._slav = [pts] # double connected circular list of active vertices
        self._ie = {} # incident edges
        self._vab = {} # vertex angle bisectors
        self._bix = [] # bisector intersections / priority queue
        self._bo = {} # bisector origin pointers
        self._skeleton = []
    
    @property
    def lav(self):
        return self._slav[-1]
    
    @property
    def skeleton(self):
        return self._skeleton
    
    def add_vab(self, vi, i):
        l1, l2 = self.lav[1:] + [self.lav[0]], [self.lav[-1]] + self.lav[:-1]
        self._ie[vi] = [(vi, l1[i]),(vi, l2[i])]
        self._vab[vi] = rs.VectorAdd(
            rs.VectorUnitize(rs.VectorCreate(l1[i], vi)),
            rs.VectorUnitize(rs.VectorCreate(l2[i], vi)))
    
    def set_ie_vab(self):
        for i, vi in enumerate(self.lav):
            self.add_vab(vi, i)

    def add_bix(self, v):
        vli = rs.AddLine(v, v+self._vab[v])
        for ve in [self._ie[v][0][1], self._ie[v][1][1]]:
            vex = rs.LineLineIntersection(
                rs.AddLine(ve, ve+self._vab[ve]),
                vli)
            if vex:
                self._bix.append((vex[0], rs.Distance(
                    rs.LineClosestPoint(
                        rs.AddLine(self._ie[v][0][0],
                            self._ie[v][0][1]),
                        vex[0]),
                    vex[0])))
                self._bo[vex[0]] = (v, ve)
    
    def set_bix_priority_queue(self):
        for v in self.lav:
            self.add_bix(v)
        self._bix.sort(key=lambda tup: tup[1])
        
    def compute_skeleton(self):
        while self._bix:
            vi = self._bix.pop()[0]
            va,vb,idx = self._bo[vi][0], self._bo[vi][1], self.lav.index(self._bo[vi][0])
            if va == None or vb == None: continue
            if self.lav[self.lav.index(va)-2] == vb: continue
            
            self._skeleton.append(rs.AddLine(va,vi))
            self._skeleton.append(rs.AddLine(vb,vi))
            
            #self._bo[i] = ((None, self._bo[i][0]), (None, self._bo[i][1]))
            
            self._bo[vi] = (None, None)
            self._slav[-1][idx] = vi
            self._slav[-1].remove(vb)
            
            self._ie[vi] = ((vi, self._ie[va][0][1]), (vi, self._ie[vb][1][1]))
            self._ie[self._ie[va][0][1]] = (self._ie[va][0], (va, vi))
            self._ie[self._ie[vb][1][1]] = ((vb, vi), self._ie[vb][1])
            print vi
            self.add_vab(vi, idx)
            self.add_bix(vi)
            
    
_temp = []
skel = Skeleton(rs.coerce3dpointlist(pts))
skel.set_ie_vab()
skel.set_bix_priority_queue()
skel.compute_skeleton()
a = skel.skeleton
b = _temp
# ---------- end python_2 ----------
geo_3 = Geometry(python.b)  # disabled
panel_2 = Panel(python.a)  # disabled
geo_4 = Geometry(python_2.b)
panel_3 = Panel(python_2.a)
